# Grasshopper definition multiple_components_at_once.gh (Grasshopper 1.0.7)
# Copyright: AMDlab
# plug-ins: MetaHopper

# 登録したい複数のコンポーネントの情報を得る
digit_scroller = DigitScroller(Scroller_Digits=12, Scroller_Prefix="B", Scroller_Radix=9, Scroller_Value=0.25)
number_slider = Slider(0.25, range=0..1)
multiplication = Multiplication(A=number_slider, B=digit_scroller)
selobj = GetSelectedObjects(AllObjects_Object=[multiplication, digit_scroller, number_slider])  # -> ComponentObjects, ParamObjects, OtherObjects
# 複数のコンポーネントの情報からデータを構成する
calc_multiplication = GhPythonScript()  # -> out, a; disabled
# ---------- calc_multiplication: Python ----------
"""Add Digit Scroller and List Item to the canvas
    Inputs:
    Output:
"""

from Grasshopper import Instances
from System.Drawing import PointF
from System import Guid

"""
put_data Description

if c[0] == "Param":
    c[0]: "Param"
    c[1]: ComponentGuid
    c[2]: Pivot ex) [0, 0]
    c[3]: PersistentData GH_Structure
    c[4]: Assign to Parameters
    c[5]: Connections
    C[6]: None

if c[0] == "Component":
    c[0]: "Component"
    c[1]: ComponentGuid
    c[2]: Pivot ex) [0, 0]
    c[3]: Assign to Parameters(Component)
    c[4]: Param Input
        c[4][0]: [PersistentData, Assign to Parameters]
        c[4][1]: [PersistentData, Assign to Parameters]
        c[4][2]: [PersistentData, Assign to Parameters]
        ...
    c[5]: Param Output
        c[5][0]: [Assign to Parameters, Connections]
        c[5][1]: [Assign to Parameters, Connections]
        c[5][2]: [Assign to Parameters, Connections]
        ...
    C[6]: None

recompute_doc_obj_id Description
    set put_data ids

"""

put_data = [
    [
        "Component", "ce46b74e-00c9-43c4-805a-193b69ea4a11",
        [60., 0.],
        None,
        [],
        [],
        None
    ],
    [
        "Param", "33bcf975-a0b2-4b54-99fd-585c893b9e88",
        [-155., 10.],
        None,
        None,
        [[0, 1]],
        None
    ],
    [
        "Param", "57da07bd-ecab-415d-9d86-af36d7073abc",
        [-110., -10.],
        None,
        None,
        [[0, 0]],
        None
    ]
]
recompute_doc_obj_id = [0]

def ParamInput(base_param, p_data):
    if type(p_data[1]) == list:
        child_param = getattr(base_param, p_data[0])
        for p_d in p_data[1]:
            ParamInput(child_param, p_d)
        return
    
    setattr(base_param, p_data[0], p_data[1])

def SetPersistentData(Param, Data):
    Param.SetPersistentData(Data)

def Callback(doc):
    for id in recompute_doc_obj_id:
        put_data[id][6].ExpireSolution(True)
    

def main():
    doc = ghenv.Component.OnPingDocument()
    u_server = doc.UndoServer
    u_server.RemoveRecord(u_server.UndoGuids[0])
    
    pivot = ghenv.Component.Attributes.Pivot
    for c in put_data:
        c_pivot = PointF(c[2][0] + pivot.X, c[2][1] + pivot.Y)
        if not (Instances
            .ActiveCanvas
            .Validator
            .CanCreateObject(Guid(c[1]), c_pivot)
        ):
            raise Exception("ERROR: Can Create Object.")
        Instances.ActiveCanvas.InstantiateNewObject(Guid(c[1]), c_pivot, False)
        c[6] = doc.Objects[doc.Objects.Count - 1]
        if c[0] == "Param":
            if c[3]: SetPersistentData(c[6], c[3])
            if c[4]:
                for c_params in c[4]:
                    ParamInput(c[6], c_params)
        elif c[0] == "Component":
            if c[3]:
                for c_param in c[3]:
                    ParamInput(c[6], c_param)
            if c[4]:
                for i, c_input in enumerate(c[4]):
                    if c_input[0]: SetPersistentData(c[6].Params.Input[i], c_input[0])
                    if c_input[1]:
                        for c_i in c_input[1]:
                            ParamInput(c[6].Params.Input[i], c_i)
            if c[5]:
                for i, c_output in enumerate(c[5]):
                    if c_output[0]:
                        for c_o in c_output[0]:
                            ParamInput(c[6].Params.Output[i], c_o)
    
    doc.DeselectAll()
    for c in put_data:
        c[6].Attributes.Selected = True
        if c[0] == "Param":
            if c[5]:
                for sid in c[5]:
                    if put_data[sid[0]][0] == "Param":
                        rid = put_data[sid[0]][6]
                    elif put_data[sid[0]][0] == "Component":
                        rid = put_data[sid[0]][6].Params.Input[sid[1]]
                    rid.AddSource(c[6])
        elif c[0] == "Component":
            for c_output in c[5]:
                sids = c_output[1]
                if sids:
                    for i, sid in enumerate(sids):
                        if put_data[sid[0]][0] == "Param":
                            rid = put_data[sid[0]][6]
                        elif put_data[sid[0]][0] == "Component":
                            rid = put_data[sid[0]][6].Params.Input[sid[1]]
                        rid.AddSource(c[6].Params.Output[i])
    
    doc.ScheduleSolution(1, Callback)
    doc.UndoUtil.MergeRecords(len(put_data))
    doc.RemoveObject(ghenv.Component, False)
    

if True:
    main()
# ---------- end calc_multiplication ----------
python = GhPythonScript(x=[selobj.ComponentObjects, selobj.ParamObjects])  # -> out, Name, ComponentGuid, BPivot
# ---------- python: Python ----------
Name = x.Name
ComponentGuid = x.ComponentGuid.ToString()
Bounds = x.Attributes.Bounds
BPivot = str(Bounds.X + Bounds.Width/2) + ", " \
    + str(Bounds.Y + Bounds.Height/2)
# ---------- end python ----------
panel = Panel(python.Name)
panel_2 = Panel(python.ComponentGuid)
panel_3 = Panel(python.BPivot)
